# Grasshopper definition 200518_carpet.gh (Grasshopper 1.0.7)

list = ValueList()
python = GhPythonScript(x=list)  # -> out, a, b
# ---------- python: Python ----------
__author__ = "gregorjahner"

# Import points from a text file
import rhinoscriptsyntax as rs
import csv
import ghpythonlib.treehelpers as th
#import pandas as pd

def calTotalNumberOfSpots():
    #df = pd.read_csv("top_100_spots.csv", usecols = ['0'])
    #return df['0'].sum()
    pass


def CSVlist():
    #prompt the user for a file to import
    filter = "CSV file (*.csv)|*.csv|*.txt|All Files (*.*)|*.*||"
    filename = rs.OpenFileName("top_100_spots", filter)
    if not filename: return

    tmplist = list()
    with open(filename) as csvfile:
    #with open('top_100_spots.csv') as csvfile:
        reader = csv.reader(csvfile)
        #reader = csv.reader(csvfile, delimiter=',')
        header_idx = True
        for row in reader:
            if header_idx == True:
                header_idx = False
                #print(row)
                continue

            lat = float(row[0])
            long = float(row[1])
            alt = float(row[2])
            print(lat, long, alt)

            rs.AddPoint(lat, long, alt)
            tmplist.append([lat, long, alt])
    print(tmplist)
    b = th.list_to_tree(tmplist)
    return b

"""
if( __name__ == "__main__" ):
    CSVlist()
    #calTotalNumberOfSpots()

"""
b = CSVlist()
# ---------- end python ----------
number_of_total_items = ListLength(List=graft(python.b))
panel = Panel(python.b)

# ---- group: Deconstruct Branch
branch = TreeBranch(Tree=simplify(python.b), Path=Slider(4, range=1..9), MaintainPaths=True)
branch_2 = TreeBranch(Tree=simplify(python.b), Path=Slider(8, range=1..9), MaintainPaths=True)
branch_3 = TreeBranch(Tree=simplify(python.b), Path=Slider(5, range=1..9), MaintainPaths=True)
branch_4 = TreeBranch(Tree=simplify(python.b), Path=Slider(3, range=1..9), MaintainPaths=True)
branch_5 = TreeBranch(Tree=simplify(python.b), Path=Slider(9, range=1..9), MaintainPaths=True)
branch_6 = TreeBranch(Tree=simplify(python.b), Path=Slider(7, range=1..9), MaintainPaths=True)
branch_7 = TreeBranch(Tree=simplify(python.b), Path=Slider(6, range=1..9), MaintainPaths=True)
branch_8 = TreeBranch(Tree=simplify(python.b), Path=Slider(1, range=1..9), MaintainPaths=True)
branch_9 = TreeBranch(Tree=simplify(python.b), Path=Slider(0, range=0..100), MaintainPaths=True)
branch_10 = TreeBranch(Tree=simplify(python.b), Path=Slider(2, range=1..9), MaintainPaths=True)
panel_2 = Panel(branch_5)
panel_3 = Panel(branch)
panel_4 = Panel(branch_4)
panel_5 = Panel(branch_2)
panel_6 = Panel(branch_6)
panel_7 = Panel(branch_3)
panel_8 = Panel(branch_7)
panel_9 = Panel(branch_9)
panel_10 = Panel(branch_8)
panel_11 = Panel(branch_10)

# ----
branch_11 = TreeBranch(Tree=simplify(python.b), Path="14", MaintainPaths=True)
branch_12 = TreeBranch(Tree=simplify(python.b), Path="18", MaintainPaths=True)  # disabled
branch_13 = TreeBranch(Tree=simplify(python.b), Path="15", MaintainPaths=True)
branch_14 = TreeBranch(Tree=simplify(python.b), Path="13", MaintainPaths=True)
branch_15 = TreeBranch(Tree=simplify(python.b), Path="19", MaintainPaths=True)
branch_16 = TreeBranch(Tree=simplify(python.b), Path="16", MaintainPaths=True)
branch_17 = TreeBranch(Tree=simplify(python.b), Path="11", MaintainPaths=True)
branch_18 = TreeBranch(Tree=simplify(python.b), Path="10", MaintainPaths=True)
branch_19 = TreeBranch(Tree=simplify(python.b), Path="12", MaintainPaths=True)
branch_20 = TreeBranch(Tree=simplify(python.b), Path="17", MaintainPaths=True)
panel_12 = Panel(branch_15)
panel_13 = Panel(branch_11)
panel_14 = Panel(branch_12)
panel_15 = Panel(branch_14)
panel_16 = Panel(branch_20)
panel_17 = Panel(branch_13)
panel_18 = Panel(branch_16)
panel_19 = Panel(branch_18)
panel_20 = Panel(branch_19)
panel_21 = Panel(branch_17)

# ---- group: Construct Points
item = ListItem(
    List=[panel_5, panel_2, panel_6, panel_8, panel_7, panel_3, panel_4, panel_11, panel_10, panel_9, panel_12, panel_14, panel_16, panel_18, panel_17, panel_13, panel_15, panel_20, panel_21, panel_19],
    Index="1",
    Wrap=True)  # -> flatten(Item)
item_2 = ListItem(
    List=[panel_5, panel_2, panel_6, panel_8, panel_7, panel_3, panel_4, panel_11, panel_10, panel_9, panel_12, panel_14, panel_16, panel_18, panel_17, panel_13, panel_15, panel_20, panel_21, panel_19],
    Index="0",
    Wrap=True)  # -> flatten(Item)
pt = ConstructPoint(XCoordinate=item_2, YCoordinate=item, ZCoordinate=0)

# ---- group: Move to Origin
bnd = Bounds(Numbers=item)
bnd_2 = Bounds(Numbers=item_2)
dedomain = DeconstructDomain(Domain=bnd_2)  # -> Start, End
dedomain_2 = DeconstructDomain(Domain=bnd)  # -> Start, End
item_3 = ListItem(List=item, Index="0", Wrap=True)
item_4 = ListItem(List=item_2, Index="0", Wrap=True)
subtraction = Subtraction(A=dedomain.End, B=dedomain.Start)
subtraction_2 = Subtraction(A=dedomain_2.End, B=dedomain_2.Start)
division = Division(A=subtraction_2, B="2")
addition = Addition(A=division, B=item_3)
division_2 = Division(A=subtraction, B="2")
addition_2 = Addition(A=division_2, B=item_4)
pt_2 = ConstructPoint(XCoordinate=addition_2, YCoordinate=addition, ZCoordinate=0)
pt_3 = Point(Point(0, 0, 0))
vec2pt = Vector2Pt(PointA=pt_2, PointB=pt_3, Unitize=False)  # -> Vector, Length
move = Move(Geometry=pt, Motion=vec2pt.Vector)  # -> Geometry, Transform

# ---- group: Scale Factor
scale = Scale(Geometry=move.Geometry, Center=pt_3, Factor=Slider(67, range=0..10000))  # -> Geometry, Transform
