# Grasshopper definition 200909_carpet_ field_experiment.gh (Grasshopper 1.0.7)

python = GhPythonScript()  # -> out, a, b
# ---------- python: Python ----------
__author__ = "gregorjahner"

# Import points from a text file
import rhinoscriptsyntax as rs
import csv
import ghpythonlib.treehelpers as th
#import pandas as pd

def calTotalNumberOfSpots():
    #df = pd.read_csv("top_spots.csv", usecols = ['0'])
    #return df['0'].sum()
    pass


def CSVlist():
    #prompt the user for a file to import
    filter = "CSV file (*.csv)|*.csv|*.txt|All Files (*.*)|*.*||"
    filename = rs.OpenFileName("top_spots.csv", filter)
    if not filename: return

    tmplist = list()
    with open(filename) as csvfile:
    #with open('top_spots.csv') as csvfile:
        reader = csv.reader(csvfile)
        #reader = csv.reader(csvfile, delimiter=',')
        header_idx = True
        for row in reader:
            if header_idx == True:
                header_idx = False
                #print(row)
                continue

            lat = float(row[0])
            long = float(row[1])
            zero = float(row[3])
            print(lat, long, zero)

            rs.AddPoint(lat, long, zero)
            tmplist.append([lat, long, zero])
    print(tmplist)
    b = th.list_to_tree(tmplist)
    return b

"""
if( __name__ == "__main__" ):
    CSVlist()
    #calTotalNumberOfSpots()

"""
b = CSVlist()
# ---------- end python ----------
panel = Panel(python.b)
cull = CullPattern(List=panel, CullPattern=[True, False, False, False])  # -> flatten(List)
cull_2 = CullPattern(List=panel, CullPattern=[False, True, False, False])  # -> flatten(List)
cull_3 = CullPattern(List=panel, CullPattern=[False, False, True, False])  # -> flatten(List)
pt = ConstructPoint(XCoordinate=cull, YCoordinate=cull_2, ZCoordinate="0")

# ---- group: Origin Scale
bnd = Bounds(Numbers=cull)
bnd_2 = Bounds(Numbers=cull_2)
div = DivideDomain(Domain=bnd, Count="2")
div_2 = DivideDomain(Domain=bnd_2, Count="2")
dispatch = Dispatch(List=div_2, DispatchPattern=[True, False])  # -> ListA, ListB
dispatch_2 = Dispatch(List=div, DispatchPattern=[True, False])  # -> ListA, ListB
dedomain = DeconstructDomain(Domain=dispatch_2.ListA)  # -> Start, End
dedomain_2 = DeconstructDomain(Domain=dispatch.ListA)  # -> Start, End
pt_2 = ConstructPoint(XCoordinate=dedomain.End, YCoordinate=dedomain_2.End, ZCoordinate=0)
neg = Negative(Value=pt_2)
move = Move(Geometry=pt, Motion=neg)  # -> Geometry, Transform
scale = Scale(Geometry=move.Geometry, Center=Point(0, 0, 0), Factor="1000")  # -> Geometry, Transform

# ---- group: Adding Field Radius
pdecon = Deconstruct(Point=scale.Geometry)  # -> XComponent, YComponent, ZComponent
division = Division(A=cull_3, B="5000")
pt_3 = ConstructPoint(XCoordinate=pdecon.XComponent, YCoordinate=pdecon.YComponent, ZCoordinate=division)

# ----
cullpt = CullDuplicates(Points=pt_3, Tolerance=Slider(10, range=0..10), CullMode=3)  # -> Points, Indices, Valence

# ---- group: Array in Line
vec = VectorXYZ(XComponent=Slider(1.019, range=0..2), YComponent=0, ZComponent=0)  # -> Vector, Length
arrlinear = LinearArray(Geometry=cullpt.Points, Direction=vec.Vector, Count=cullpt.Valence)  # -> Geometry, Transform
cull_i = CullIndex(List=arrlinear.Geometry, Indices="0", Wrap=True)

# ---- group: Bnd Region r = how often
faktor_multiplication = Slider(15.8, range=0..20)
pdecon_2 = Deconstruct(Point=cullpt.Points)  # -> XComponent, YComponent, ZComponent
pt_4 = ConstructPoint(XCoordinate=pdecon_2.XComponent, YCoordinate=pdecon_2.YComponent, ZCoordinate=0)
multiplication = Multiplication(A=pdecon_2.ZComponent, B=faktor_multiplication)
cir = Circle(Plane=pt_4, Radius=multiplication)
runion = RegionUnion(Curves=cir)

# ---- group: Pipe view
movetoplane = MoveToPlane(Geometry=pt_3, Plane=PlaneXY(0, 0, 0), Above=True, Below=True)  # -> Geometry, Transform
ln = Line(StartPoint=pt_3, EndPoint=movetoplane.Geometry)
pipe = Pipe(Curve=ln, Radius=Slider(0.2, range=0..1), Caps="1")

# ----
round = Round(Number=multiplication)  # -> Nearest, Floor, Ceiling

# ---- group: Bnd(Bnd;Pop)
boundary = BoundarySurfaces(Edges=runion)
box_corners = BoxCorners(Box=boundary)  # -> CornerA, CornerB, CornerC, CornerD, CornerE, CornerF, CornerG, CornerH
srf4pt = _4PointSurface(CornerA=box_corners.CornerA, CornerB=box_corners.CornerB, CornerC=box_corners.CornerC, CornerD=box_corners.CornerD)
scale_2 = Scale(Geometry=srf4pt, Center=Point(0, 0, 0), Factor=Slider(1.1, range=1..1.5))  # -> Geometry, Transform
rdiff = RegionDifference(CurvesA=scale_2.Geometry, CurvesB=boundary)
boundary_2 = BoundarySurfaces(Edges=rdiff)
popgeo = PopulateGeometry(Geometry=scale_2.Geometry, Count=Slider(41, range=0..50), Seed=1)  # -> flatten(Population)

# ---- group: Field test 1
visible_charges = Point(pt_4)

# ---- group: Field test 1 / Spin Force
fspin = SpinForce(
    Plane=visible_charges,
    Strength=Slider(0.1, range=0..100),
    Radius=round.Nearest,
    Decay=Slider(1.3, range=0..20),
    Bounds=runion)

# ---- group: Field test 1 / Point Charge
pcharge = PointCharge(Point=visible_charges, Charge=Slider(35.9, range=0..50), Decay=Slider(2.6, range=0..10), Bounds=runion)

# ---- group: Field test 1 / Field Start points
cir_2 = Circle(Plane=visible_charges, Radius=Slider(0.01, range=0..5))
divide = DivideCurve(Curve=cir_2, Count=round.Nearest, Kinks=False)  # -> flatten(Points), Tangents, Parameters

# ---- group: Field test 1 (continued)
mergef = MergeFields(Fields=[pcharge, fspin])

# ---- group: Field test 1 / Field Lines
fline = FieldLine(Field=mergef, Point=divide.Points, Steps=Slider(959, range=0..1000), Accuracy=0.1, Method=3)
