# Grasshopper definition 200917_carpet_reduced_data_JSLM.gh (Grasshopper 1.0.7)

python = GhPythonScript()  # -> out, a, b
# ---------- python: Python ----------
__author__ = "gregorjahner"

# Import points from a text file
import rhinoscriptsyntax as rs
import csv
import ghpythonlib.treehelpers as th
#import pandas as pd

def calTotalNumberOfSpots():
    #df = pd.read_csv("top_spots.csv", usecols = ['0'])
    #return df['0'].sum()
    pass


def CSVlist():
    #prompt the user for a file to import
    filter = "CSV file (*.csv)|*.csv|*.txt|All Files (*.*)|*.*||"
    filename = rs.OpenFileName("top_spots.csv", filter)
    if not filename: return

    tmplist = list()
    with open(filename) as csvfile:
    #with open('top_spots.csv') as csvfile:
        reader = csv.reader(csvfile)
        #reader = csv.reader(csvfile, delimiter=',')
        header_idx = True
        for row in reader:
            if header_idx == True:
                header_idx = False
                #print(row)
                continue

            lat = float(row[1])
            long = float(row[2])
            alt = float(row[3])
            print(lat, long, alt)

            rs.AddPoint(lat, long, alt)
            tmplist.append([lat, long, alt])
    print(tmplist)
    b = th.list_to_tree(tmplist)
    return b

"""
if( __name__ == "__main__" ):
    CSVlist()
    #calTotalNumberOfSpots()

"""
b = CSVlist()
# ---------- end python ----------
panel = Panel(python.b)
cull = CullPattern(List=panel, CullPattern=[True, False, False, False])  # -> flatten(List)
cull_2 = CullPattern(List=panel, CullPattern=[False, True, False, False])  # -> flatten(List)
cull_3 = CullPattern(List=panel, CullPattern=[False, False, True, False])  # -> flatten(List)

# ---- group: Bnd Midpoint
bnd = Bounds(Numbers=cull)
bnd_2 = Bounds(Numbers=cull_2)
div = DivideDomain(Domain=bnd, Count="2")
div_2 = DivideDomain(Domain=bnd_2, Count="2")
dispatch = Dispatch(List=div, DispatchPattern=[True, False])  # -> ListA, ListB
dispatch_2 = Dispatch(List=div_2, DispatchPattern=[True, False])  # -> ListA, ListB
dedomain = DeconstructDomain(Domain=dispatch_2.ListA)  # -> Start, End
dedomain_2 = DeconstructDomain(Domain=dispatch.ListA)  # -> Start, End
pt = ConstructPoint(XCoordinate=dedomain_2.End, YCoordinate=dedomain.End, ZCoordinate=0)
neg = Negative(Value=pt)

# ----
pt_2 = ConstructPoint(XCoordinate=cull, YCoordinate=cull_2, ZCoordinate=0)

# ---- group: Bnd Z
dom = ConstructDomain(DomainStart="700", DomainEnd="780")
inc = Includes(Value=cull_3, Domain=dom)  # -> Includes, Deviation
dispatch_3 = Dispatch(List=cull_3, DispatchPattern=inc.Includes)  # -> ListA, ListB

# ---- group: Scale XY
move = Move(Geometry=pt_2, Motion=neg)  # -> Geometry, Transform
scale = Scale(Geometry=move.Geometry, Center=Point(0, 0, 0), Factor="1000")  # -> Geometry, Transform

# ---- group: Scale Z
division = Division(A=dispatch_3.ListA, B="10")

# ----
pdecon = Deconstruct(Point=scale.Geometry)  # -> XComponent, YComponent, ZComponent
pt_3 = ConstructPoint(XCoordinate=pdecon.XComponent, YCoordinate=pdecon.YComponent, ZCoordinate=division)

# ---- group: 3 Faktor Größen
number_slider = Slider(2, range=0..10)
cullpt = CullDuplicates(Points=scale.Geometry, Tolerance=number_slider, CullMode=3)  # -> Points, Indices, Valence
cullpt_2 = CullDuplicates(Points=scale.Geometry, Tolerance=Slider(17, range=0..100), CullMode=3)  # -> Points, Indices, Valence
cullpt_3 = CullDuplicates(Points=scale.Geometry, Tolerance=Slider(0.5, range=0.01..5), CullMode=3)  # -> Points, Indices, Valence
sort = SortList(Keys=cullpt_3.Valence, ValuesA=cullpt_3.Points)  # -> Keys, ValuesA
sort_2 = SortList(Keys=cullpt.Valence, ValuesA=cullpt.Points)  # -> Keys, ValuesA
sort_3 = SortList(Keys=cullpt_2.Valence, ValuesA=cullpt_2.Points)  # -> Keys, ValuesA

# ---- group: XY Polyline, bereinigt
pline = PolyLine(Vertices=pt_3, Closed=False)
explode = Explode(Curve=pline, Recursive=True)  # -> Segments, Vertices
crv = Curve(explode.Segments)
smaller = SmallerThan(FirstNumber=crv, SecondNumber=Slider(5.18, range=0..30))  # -> SmallerThan, OrEqualTo
dispatch_4 = Dispatch(List=crv, DispatchPattern=smaller.SmallerThan)  # -> ListA, ListB
crv_2 = Curve(dispatch_4.ListA)
join = JoinCurves(Curves=crv_2, Preserve=False)

# ---- group: Field Design
strenght = Slider(0.1, range=0..5)
decay = Slider(2.5, range=1..10)
radius = Slider(8.1, range=1..10)
lng = ListLength(List=sort_3.Keys)
lng_2 = ListLength(List=sort_3.Keys)
lng_3 = ListLength(List=sort_3.Keys)
series = Series(Start="1", Step="1", Count=lng)
series_2 = Series(Start="1", Step="1", Count=lng_2)
series_3 = Series(Start="1", Step="1", Count=lng_3)
multiplication = Multiplication(A=series, B=radius)
multiplication_2 = Multiplication(A=series_2, B=strenght)
multiplication_3 = Multiplication(A=series_3, B=decay)

# ---- group: Eliminate Douplicators F2
division_2 = Division(A=number_slider, B="2")
cir = Circle(Plane=sort_3.ValuesA, Radius=division_2)
incurves = PointInCurves(Point=sort_2.ValuesA, Curves=cir)  # -> Relationship, Index, Point
bool = Boolean(incurves.Relationship)
not = GateNot(A=bool)
cull_4 = CullPattern(List=incurves.Point, CullPattern=not)

# ----
cir_2 = Circle(Plane=sort.ValuesA, Radius=Slider(0.8, range=0..1))
# was ist noch so möglich?
runion = RegionUnion(Curves=cir_2)
reb = RebuildCurve(Curve=runion, Count=Slider(100, range=0..100), Tangents=False)
cull_5 = CullPattern(List=sort_2.Keys, CullPattern=not)
boundary = BoundarySurfaces(Edges=reb)

# ---- group: Field Design / Field Lines
cp = ClosestPoint(Point=cull_4)  # -> ClosestPoint, CPIndex, Distance
fspin = SpinForce(Plane=sort_3.ValuesA, Strength=multiplication_2, Radius=multiplication, Decay=multiplication_3)
multiplication_4 = Multiplication(A=cp.Distance, B=Slider(5000, range=0..10000))
mergef = MergeFields(Fields=fspin)
fline = FieldLine(Field=mergef, Point=cull_4, Steps=multiplication_4, Accuracy=0.1, Method=3)

# ---- group: Field Design / Simplify Curves
redpline = Reduce(Polyline=fline, Tolerance=Slider(0.01, range=0..0.1))  # -> flatten(Polyline), Reduction
explode_2 = Explode(Curve=redpline.Polyline, Recursive=True)  # -> Segments, Vertices
cullpt_4 = CullDuplicates(Points=explode_2.Vertices, Tolerance=Slider(1.4, range=0..10), CullMode=3)  # -> Points, Indices, Valence
intcrv = Interpolate(Vertices=cullpt_4.Points, Degree=3, Periodic=Toggle(True), KnotStyle=1)  # -> flatten(Curve), Length, Domain

# ----
len = Length(Curve=intcrv.Curve)  # -> flatten(Length)
sort_4 = SortList(Keys=len, ValuesA=intcrv.Curve)  # -> Keys, ValuesA

# ----
# bake by layer
panel_2 = Panel("CurveLayer_")
bake = Button()
lng_4 = ListLength(List=sort_4.ValuesA)
series_4 = Series(Start=0, Step=1, Count=lng_4)
expression = Expression(x=panel_2, y=series_4, Expression="Format(\"{0}{1}\", x, y)")
delete_all = Button()
delall = PythonScript(layer=expression, delObj=delete_all)  # -> out; inputs layer: list, delObj: Boolean
# ---------- delall: Python ----------
import rhinoscriptsyntax as rs
import scriptcontext as sc
from Rhino import RhinoDoc

if (delObj):
    try:
        sc.doc = RhinoDoc.ActiveDoc
        for aLayer in layer:
            if rs.IsLayer(aLayer):
                objects = rs.ObjectsByLayer(aLayer, False)
                if (objects and len(objects) > 0):
                    rs.DeleteObjects(objects)
                    print('{0} deleted [{1}]'.format(len(objects), aLayer))

    finally:
        # now, add all geometry to Grasshopper doc
        sc.doc = ghdoc
# ---------- end delall ----------
bake_2 = GhPythonScript(geo=sort_4.ValuesA, layer=expression, mSrc=0, active=bake)  # -> out; inputs mSrc: Int32
# ---------- bake_2: Python ----------
__author__ = "Joseph Oster, IslandCAD.com"
__version__ = "2020.01.21"

import rhinoscriptsyntax as rs
import scriptcontext
import Rhino

#this must be done before changing the scriptcontext?
doc_object = rs.coercerhinoobject(geo)

if active:
    #we change the scriptcontext
    scriptcontext.doc = Rhino.RhinoDoc.ActiveDoc
    try:
        attributes = doc_object.Attributes
        geometry = doc_object.Geometry

        if layer is None: layer = 'Default'
        if not rs.IsLayer(layer): rs.AddLayer(layer)

        if rM is not None:
            matIndex = scriptcontext.doc.Materials.Add(rM)
            attributes.MaterialIndex = matIndex

        if (mSrc < 0) or (mSrc > 3): mSrc = 1 #must be 0=layer, 1=object or 2=parent
        if (mSrc == 0): #from layer
            if rM is not None:
                layerIndex = rs.LayerNames().index(layer)
                Rhino.RhinoDoc.ActiveDoc.Layers[layerIndex].RenderMaterial = Rhino.Render.RenderMaterial.CreateBasicMaterial(rM)
            attributes.MaterialSource = Rhino.DocObjects.ObjectMaterialSource.MaterialFromLayer
        elif (mSrc == 1): #from object
            attributes.MaterialSource = Rhino.DocObjects.ObjectMaterialSource.MaterialFromObject
        else: #from parent
            attributes.MaterialSource = Rhino.DocObjects.ObjectMaterialSource.MaterialFromParent

        # add both the geometry and the attributes to the Rhino doc
        rhino_geo = scriptcontext.doc.Objects.Add(geometry, attributes)
        rs.ObjectLayer(rhino_geo, layer)

    finally: #put back the original Grasshopper document as default
        scriptcontext.doc = ghdoc
# ---------- end bake_2 ----------

lng_5 = ListLength(List=sort_4.ValuesA)
subtraction = Subtraction(A=lng_5, B="1")
item = ListItem(List=sort_4.ValuesA, Index=subtraction, Wrap=True)
boundary_2 = BoundarySurfaces(Edges=item)
